# Grasshopper definition gh_gcode_221203.ghx (Grasshopper 1.0.7)

brep = Brep([<brep referenced from the Rhino model> x74])

# ---- group: Layer Height
number_slider = Slider(0.15, range=0..1)

# ---- group: Test Breps
# 221203 - GH_Gcode for HW
# 
# Workflow
# (0) Brep to Polylines
# (1) Polylines to Points
# (2) Points to Gcode
# (0) Brep to Polylines
brep_2 = Brep([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])

# ----
viewer = ParamViewer(brep)
panel = Panel("C:\Users\ysoky\Documents\FabCafe\GH_Gcode_for_TL\_result\2021-08-22_17-31-45.gcode")

# ---- group: ex) Windows
panel_2 = Panel("C:\Users\ysoky\Documents\FabCafe\GH_Gcode_for_TL\_test\210814_test.gcode")

# ---- group: ex) MacOS
# Gcode Viewer ( Gcode to Polyline )
panel_3 = Panel("/Users/yoshionao_mbp/Documents/FabCafe/GH_Gcode_for_TL/_test/210814_test.gcode")

# ---- group: (0) Breps to Polyline / INPUT : Breps
brep_3 = Brep(brep_2)

# ----
txt = Text(panel)
python = GhPythonScript(PATH=txt)  # -> out, MOVE, a
# ---------- python: Python ----------
################################################################################
###                                                                          ###
###   GH_Gcode for TL                                                        ###
###                                                                          ###
###       Component : Viewer_Marlin / 210822                                 ###
###                                                                          ###
###                                                                          ###
###   Base Script >>> GH_Gcode                                               ###
###                                                                          ###
###       Repository : https://github.com/naysok/GH_Gcode                    ###
###       Coding : naoki yoshioka (naysok)                                   ###
###       License : MIT License                                              ###
###                                                                          ###
###   Update, 210822 / ysok (G29)                                            ###
###                                                                          ###
################################################################################


import datetime
import math

import rhinoscriptsyntax as rs
import Rhino.Geometry as rg


class Util():


    def get_current_time(self):
        return str(datetime.datetime.now().strftime("%Y-%m-%d_%H-%M-%S"))


    def remap_number(self, src, old_min, old_max, new_min, new_max):
        return ((src - old_min) / (old_max - old_min) * (new_max - new_min) + new_min)


    def flatten_runtime_list(self, list):
        all = []
        
        for i in xrange(len(list)):
            # print(i)
            sub = list[i]
            for j in xrange(len(sub)):
                # print(j)
                all.append(sub[j])

        return all


    def export_gcode(self, dir_path, txt):

        now = self.get_current_time()
        file_path = dir_path + now + ".gcode"

        ### Export
        with open(file_path, 'w') as f:
            f.write(txt)

        print("Export GCode : {}".format(file_path))


    def zip_matrix(self, mat):
        ### https://note.nkmk.me/python-list-transpose/
        return [list(x) for x in zip(*mat)]


    def padding_previous_value(self, list_):
        
        list_pad = []

        for i in xrange(len(list_)):
            
            item_ = list_[i]

            ### First 
            if i == 0:
                if (item_ == None):
                    list_pad.append(0)
                else:
                    list_pad.append(item_)
            
            ### Not Frist
            else:
                if (item_ == None):
                    tmp = list_pad[i-1]
                    list_pad.append(tmp)
                else:
                    list_pad.append(item_)
        
        return list_pad


    def remove_previous_elements(self, a_list):

        ### Remove Same Element as the Previous One
        new_list = []
        src_length = len(a_list)

        for i in range(src_length):
            tmp = a_list[i]

            ### 
            if i < src_length-1:
                if a_list[i] != a_list[i+1]:
                    new_list.append(tmp)
            ### Last
            else:
                new_list.append(tmp)
                
        return new_list


    def bitwise_or_arrays(self, arrays):

        ### Merge Bool from Brep.isPointInside

        # print(len(arrays[0]))
        # print(len(arrays[0][0]))

        if len(arrays) == 1:
            return arrays[0]

        else:
            arrays_zip = self.zip_matrix(arrays)
            # print(len(arrays_zip))
            # print(len(arrays_zip[0]))
            # print(len(arrays_zip[0][0]))

            bool_inside = []

            for i in xrange(len(arrays_zip)):
                # print(i)

                sub_ = []

                item = arrays_zip[i]
                item_zip = self.zip_matrix(item)

                # print(len(item_zip))
                # print(len(item_zip[0]))

                for j in xrange(len(item_zip)):

                    values = item_zip[j]
                    
                    if True in values:
                        sub_.append(True)
                    else:
                        sub_.append(False)

                bool_inside.append(sub_)

            # print(len(bool_inside))
            # print(len(bool_inside[0]))

            return bool_inside

ut = Util()


################################################################################


class ViewerMarlin():
    
    
    def open_file(self, path):
        with open(path) as f:
            l = f.readlines()
        # print(type(l))
        # print(len(l))
        # print(l)
        return l


    def get_value_move(self, str_):
        
        ### Split Elements
        ### Remove n
        str_.replace("\n", "")
        
        ### Remove Comments
        if ";" in str_:
            str_rm_comment = str_.split(";")
            new_str = str_rm_comment[0]
        else:
            new_str = str_

        ### Gcode (per Line)
        # print(new_str)

        ### Split Space
        elements = new_str.split()

        ### init
        xx = None
        yy = None
        zz = None
        ee = None
        
        for i in xrange(len(elements)):
            elm = elements[i]

            ### Get Value
            if ("X" in elm):
                tmp_x = elm.split("X")
                xx = float(tmp_x[1])
            
            elif ("Y" in elm):
                tmp_y = elm.split("Y")
                yy = float(tmp_y[1])
            
            elif ("Z" in elm):
                tmp_z = elm.split("Z")
                zz = float(tmp_z[1])

            elif ("E" in elm):
                tmp_e = elm.split("E")
                ee = float(tmp_e[1])

        return [xx, yy, zz, ee]


    def gcode_operate_move(self, gcode_line):

        none_list = [None, None, None, None]

        ### Move
        if ("G0" in gcode_line) or \
            ("G1" in gcode_line) or \
            ("G00" in gcode_line) or \
            ("G01" in gcode_line) or \
            ("G92 E0" in gcode_line):
            ### get position
            return self.get_value_move(gcode_line)

        ### Commment Out
        elif (";" in gcode_line[0]) or (gcode_line == "\n"):
            return none_list

        ### Setting G
        elif ("G4" in gcode_line) or \
            ("G04" in gcode_line) or \
            ("G21" in gcode_line) or \
            ("G28" in gcode_line) or \
            ("G29" in gcode_line) or \
            ("G90" in gcode_line) or \
            ("G91" in gcode_line) or \
            ("G92" in gcode_line):
            
            return none_list

        ### Setting M
        elif ("M82" in gcode_line) or \
            ("M84" in gcode_line) or \
            ("M104" in gcode_line) or \
            ("M106" in gcode_line) or \
            ("M107" in gcode_line) or \
            ("M109" in gcode_line) or \
            ("M140" in gcode_line) or \
            ("M190" in gcode_line) or \
            ("M204" in gcode_line) or \
            ("M205" in gcode_line):

            return none_list
        
        ### Setting T
        elif ("T0" in gcode_line) or \
            ("T1" in gcode_line):
            return none_list

        else:
            # return none_list
            return "bug!"


    def gcode_to_array(self, path):

        ### open gcode
        gcode = self.open_file(path)

        ### Get Vaules from gcode
        values = []
        for i in xrange(len(gcode)):
            gcode_line = gcode[i]

            ### XYZE
            elements = self.gcode_operate_move(gcode_line)

            ## DEBUG ALL
            # print(i, gcode_line)
            ### DEBUG bug
            if (elements == "bug!"):
                print(i, gcode_line)
            ## DEBUG

            values.append(elements)

        ### Padding Previous Value(None)
        values_zip = ut.zip_matrix(values)
        # print(len(values_zip))
        new_values = []
        for j in xrange(len(values_zip)):
            list_ = values_zip[j]
            list_pad = ut.padding_previous_value(list_)
            new_values.append(list_pad)
        gcode_values = ut.zip_matrix(new_values)

        # print(len(values))
        # print(len(gcode_values), len(gcode_values[0]))

        return gcode_values


    def segment_extrude(self, xyze):

        ### Segment Print / Travel
        ### https://docs.google.com/spreadsheets/d/1S4SQ-NT09Nh8sb3Lg6FSauKB1rZPMwLSDjvnrKerXFs/edit?usp=sharing
        array_seg = []
        list_seg = []

        for j in xrange(len(xyze)):

            xxx, yyy, zzz, eee = xyze[j]
            item = [xxx, yyy, zzz]
            
            # print(j)
            # print(j, xyze[j])

            ### Index[0]
            if (j == 0):
                
                x1, y1, z1, e1 = xyze[j]
                x2, y2, z2, e2 = xyze[j + 1]

                bool_b = e1 < e2

                if (bool_b == True):
                    list_seg = []
                    list_seg.append(item)
                
            ### Index[0] - Index[Last - 1]
            elif (j > 0) and (j < (len(xyze) - 1)):

                x0, y0, z0, e0 = xyze[j - 1]
                x1, y1, z1, e1 = xyze[j]
                x2, y2, z2, e2 = xyze[j + 1]

                bool_a = e0 < e1
                bool_b = e1 < e2

                if (bool_a == False) and (bool_b == True):
                    list_seg = []
                    list_seg.append(item)

                elif (bool_a == True) and (bool_b == True):
                    list_seg.append(item)

                elif (bool_a == True) and (bool_b == False):
                    list_seg.append(item)
                    array_seg.append(list_seg)

                elif (bool_a == False) and (bool_b == False):
                    pass

                else:
                    print("Error!!")
            
            ### Index[Last]
            elif (j == (len(xyze) - 1)):
                
                x0, y0, z0, e0 = xyze[j - 1]
                x1, y1, z1, e1 = xyze[j]

                bool_a = e0 < e1
                
                if (bool_a == True):
                    list_seg.append(item)
                    array_seg.append(list_seg)

        # print(array_out)

        return array_seg


    def remove_invalid_polylines(self, array_seg):

        ### Remove Invalid Polylines (Remove Same Element as the Previous One)
        layers = []

        for k in xrange(len(array_seg)):
            tmp_layer = array_seg[k]
            tmp_removed = ut.remove_previous_elements(tmp_layer)
            
            if len(tmp_removed) != 1:
                layers.append(tmp_removed)

        return layers


    def draw_path(self, values_4):

        ### Remove Same Element as the Previous One
        xyze = ut.remove_previous_elements(values_4)
        ### print(len(values_4), len(xyze))

        ### Segment Print / Travel
        array_seg = self.segment_extrude(xyze)

        ### Remove Invalid Polylines (Remove Same Element as the Previous One)
        layers = self.remove_invalid_polylines(array_seg)

        """
        ### Draw All Path
        pts = []
        for i in xrange(len(xyze)):
            x, y, z, e = values_4[i]
            pt = [x, y, z]
            pts.append(pt)
        """

        return layers


vm = ViewerMarlin()


################################################################################


ghenv.Component.Message = 'Viewer_Marlin / 210822'


print(PATH)

### gcode-file to Memory
xyze = vm.gcode_to_array(PATH)


### Pick Values
xyz = vm.draw_path(xyze)


### Draw Printing
layers = []
for layer_num in xrange(len(xyz)):
    layer_tmp = xyz[layer_num]
    pl = rs.AddPolyline(layer_tmp)
    # print(pl)
    layers.append(pl)


MOVE = layers
# ---------- end python ----------
lng = ListLength(List=python.out)

# ---- group: Render with Sequence
disc = Discontinuity(Curve=python.MOVE, Level=1)  # -> Points, Parameters
flatten = FlattenTree(Tree=disc.Points, Path="{0}")
lng_2 = ListLength(List=flatten)
multiplication = Multiplication(A=lng_2, B=Slider(0.038, range=0..1))
split = SplitList(List=flatten, Index=multiplication)  # -> ListA, ListB
pline = PolyLine(Vertices=split.ListA, Closed=False)

# ----
crv = Curve(python.MOVE)
panel_4 = Panel(lng)

# ---- group: Export
toggle = BooleanToggle(False)

# ---- group: TEMP_BED
panel_5 = Panel("60")

# ---- group: Z_Buffer (Travel)
panel_6 = Panel("10")

# ---- group: E_AMP
panel_7 = Panel("1.0")

# ---- group: F
panel_8 = Panel("480")

# ---- group: TEMP_NOZZLE
panel_9 = Panel("230")

# ---- group: ex) Windows
panel_10 = Panel("C:\Users\ysoky\Documents\FabCafe\GH_Gcode_for_TL\_result\")

# ---- group: ex) MacOS
panel_11 = Panel("/Users/yoshionao_mbp/Documents/FabCafe/GH_Gcode_for_TL/_result/")

# ---- group: Z_OFFSET
panel_12 = Panel("0")

# ---- group: E_RETRACT
panel_13 = Panel("0.2")

# ---- group: E_RETRACT_BACK
panel_14 = Panel("0.3")

# ----
# Base Script >>> GH_Gcode
#     - Repository : https://github.com/naysok/GH_Gcode
#     - Coding : naoki yoshioka (naysok)
#     - License : MIT License
# 
# Update 210822, Update Auto Leveling
# Update 210226, Update Add E_Retract
# Update 221128, Bug_Fix for E_Retract
# Update 221203, Update E_Retract
txt_2 = Text("C:\Users\SJ018\Desktop\GH_Gcode_for_TL\_result\")

# ---- group: (0) Breps to Polyline
contour = Contour(Shape=brep_3, Point=Point(0, 0, 0), Direction=Vector(0, 0, 1), Distance=number_slider)
trim = TrimTree(Tree=contour, Depth=1)

# ---- group: (0) Breps to Polyline / Remove Z=0 Curve
midpt = CurveMiddle(Curve=trim)
pdecon = Deconstruct(Point=midpt)  # -> XComponent, YComponent, ZComponent
smaller = SmallerThan(FirstNumber="0.01", SecondNumber=pdecon.ZComponent)  # -> SmallerThan, OrEqualTo
dispatch = Dispatch(List=trim, DispatchPattern=smaller.SmallerThan)  # -> ListA, ListB

# ---- group: (0) Breps to Polyline / Remove Z=0 Curve / Printable
crv_2 = Curve(dispatch.ListA)

# ---- group: (0) Breps to Polyline / Remove Z=0 Curve / Remove : Z = 0
crv_3 = Curve(dispatch.ListB)

# ---- group: (0) Breps to Polyline / Sort Curve
flatten_2 = FlattenTree(Tree=crv_2, Path="{0}")
midpt_2 = CurveMiddle(Curve=flatten_2)
pdecon_2 = Deconstruct(Point=midpt_2)  # -> XComponent, YComponent, ZComponent
sort = SortList(Keys=pdecon_2.ZComponent, ValuesA=flatten_2)  # -> Keys, ValuesA

# ---- group: (0) Breps to Polyline (continued)
topoly = CurveToPolyline(Curve=sort.ValuesA, ToleranceDistance=0, ToleranceAngle=0)  # -> Polyline, Segments

# ---- group: (0) Breps to Polyline / OUTPUT : Polylines
crv_4 = Curve(topoly.Polyline)

# ---- group: Input Polyline
# (1) Polylines to Points
crv_5 = Curve(crv_4)

# ----
polyline_to_points = GhPythonScript(POLYLINES=crv_5, Z_OFFSET_VALUE=panel_12)  # -> PRINT_CURVES, PRINT_LENGTH, MACHINE, POINTS, INFO; inputs POLYLINES: list
# ---------- polyline_to_points: Python ----------
################################################################################
###                                                                          ###
###   GH_Gcode for TL                                                        ###
###                                                                          ###
###       Component : (1) Polyline to Points / 201123                        ###
###                                                                          ###
###                                                                          ###
###   Base Script >>> GH_Gcode                                               ###
###                                                                          ###
###       Repository : https://github.com/naysok/GH_Gcode                    ###
###       Coding : naoki yoshioka (naysok)                                   ###
###       License : MIT License                                              ###
###                                                                          ###
################################################################################



import math

import rhinoscriptsyntax as rs
import Rhino.Geometry as rg


class Util():


    def get_current_time(self):
        return str(datetime.datetime.now().strftime("%Y-%m-%d_%H-%M-%S"))


    def remap_number(self, src, old_min, old_max, new_min, new_max):
        return ((src - old_min) / (old_max - old_min) * (new_max - new_min) + new_min)


    def flatten_runtime_list(self, list):
        all = []
        
        for i in xrange(len(list)):
            # print(i)
            sub = list[i]
            for j in xrange(len(sub)):
                # print(j)
                all.append(sub[j])

        return all


    def export_gcode(self, dir_path, txt):

        now = self.get_current_time()
        file_path = dir_path + now + ".gcode"

        ### Export
        with open(file_path, 'w') as f:
            f.write(txt)

        print("Export GCode : {}".format(file_path))


    def zip_matrix(self, mat):
        ### https://note.nkmk.me/python-list-transpose/
        return [list(x) for x in zip(*mat)]


    def padding_previous_value(self, list_):
        
        list_pad = []

        for i in xrange(len(list_)):
            
            item_ = list_[i]

            ### First 
            if i == 0:
                if (item_ == None):
                    list_pad.append(0)
                else:
                    list_pad.append(item_)
            
            ### Not Frist
            else:
                if (item_ == None):
                    tmp = list_pad[i-1]
                    list_pad.append(tmp)
                else:
                    list_pad.append(item_)
        
        return list_pad


    def remove_previous_elements(self, a_list):

        ### Remove Same Element as the Previous One
        new_list = []
        src_length = len(a_list)

        for i in range(src_length):
            tmp = a_list[i]

            ### 
            if i < src_length-1:
                if a_list[i] != a_list[i+1]:
                    new_list.append(tmp)
            ### Last
            else:
                new_list.append(tmp)
                
        return new_list


    def bitwise_or_arrays(self, arrays):

        ### Merge Bool from Brep.isPointInside

        # print(len(arrays[0]))
        # print(len(arrays[0][0]))

        if len(arrays) == 1:
            return arrays[0]

        else:
            arrays_zip = self.zip_matrix(arrays)
            # print(len(arrays_zip))
            # print(len(arrays_zip[0]))
            # print(len(arrays_zip[0][0]))

            bool_inside = []

            for i in xrange(len(arrays_zip)):
                # print(i)

                sub_ = []

                item = arrays_zip[i]
                item_zip = self.zip_matrix(item)

                # print(len(item_zip))
                # print(len(item_zip[0]))

                for j in xrange(len(item_zip)):

                    values = item_zip[j]
                    
                    if True in values:
                        sub_.append(True)
                    else:
                        sub_.append(False)

                bool_inside.append(sub_)

            # print(len(bool_inside))
            # print(len(bool_inside[0]))

            return bool_inside

ut = Util()


class Transform():


    def pt_pt_add(self, pt0, pt1):
        pt = [
            float(pt1[0]) + float(pt0[0]),
            float(pt1[1]) + float(pt0[1]),
            float(pt1[2]) + float(pt0[2])]
        return pt


    def pt_pt_subtract(self, pt0, pt1):
        pt = [
            float(pt0[0]) - float(pt1[0]),
            float(pt0[1]) - float(pt1[1]),
            float(pt0[2]) - float(pt1[2])]
        return pt


    def vector_multiplicate(self, vector, value):
        vec = [
            float(vector[0]) * value,
            float(vector[1]) * value,
            float(vector[2]) * value]
        return vec


    def vector_unitize(self, vector):
        length = math.sqrt(
            math.pow(float(vector[0]), 2) + 
            math.pow(float(vector[1]), 2) + 
            math.pow(float(vector[2]), 2))
        new_vector = self.vector_multiplicate(vector, (1.0 / length))
        return new_vector


    def move_pt_vec(self, pt, vec):
        p = [
            float(pt[0]) + float(vec[0]),
            float(pt[1]) + float(vec[1]),
            float(pt[2]) + float(vec[2])]
        return p

tr = Transform()


class Curve():


    def polyline_to_points(self, polyline):

        ########## NEW CODE ##########

        ### Polyline to Points by RhinoCommon
        pl = rs.coercegeometry(polyline)
        new_pl = rg.PolylineCurve.ToPolyline(pl)
        points = new_pl.ToArray()

        ########## NEW CODE ##########

        """
        ########## OLD CODE 1 ##########
        ### Start-Point + CurveDiscontinuity + End-Point
        points = []
        ### Start Point
        start_pt = rs.CurveStartPoint(polyline)
        points.append(start_pt)
        ### Segment Points
        ### Style : 3 = C2 - Continuous first and second derivative
        segments = rs.CurveDiscontinuity(polyline, 3)
        for j in range(len(segments)):
            points.append(segments[j])
        ### End Point
        end_pt =  rs.CurveEndPoint(polyline)
        points.append(end_pt)
        ########## OLD CODE 1 ##########
        """

        """
        ########## OLD CODE 2 ##########
        
        ### Polyline to Points by rhinoscriptsuntax
        ### https://developer.rhino3d.com/api/RhinoScriptSyntax/#collapse-PolylineVertices
        
        points = rs.PolylineVertices(polyline)
        
        ########## OLD CODE 2 ##########
        """
        
        return points


    def polylines_to_points(self, polylines):

        points_array = []

        for i in xrange(len(polylines)):

            points = self.polyline_to_points(polylines[i])
            points_array.append(points)

        return points_array


    def offset_z_curves(self, curves, z_offset_value):

        move_vec = rs.CreateVector(0, 0, z_offset_value)
        geos_off = rs.MoveObjects(curves, move_vec)
        
        return geos_off

op_c = Curve()


##########

##########


ghenv.Component.Message = '(1) Polyline to Points / 201123'


### Z OFFSET
offset_curves = op_c.offset_z_curves(POLYLINES, Z_OFFSET_VALUE)
#DEV = offset_curves
INFO = Z_OFFSET_VALUE


### Polylines to Points
pts = op_c.polylines_to_points(offset_curves)
POINTS = pts


def print_preview(points_array):

    pls = []
    lens_ = 0.0

    for i in xrange(len(points_array)):
        pl = rg.Polyline(points_array[i])
        pls.append(pl)
        
        len_ = pl.Length
        lens_ += float(len_)
        
    lens_int = int(lens_)

    return pls, lens_int

def draw_machine(w, h):
    rc = rs.AddRectangle(rs.WorldXYPlane(), w, h)
    return rc


### Print Preview

print_crvs, print_len = print_preview(pts)
__PRINT_CURVES = print_crvs
__PRINT_LENGTH = print_len


### Draw Machine
MACHINE = draw_machine(400, 400)
# ---------- end polyline_to_points ----------
panel_15 = Panel(polyline_to_points.INFO)
panel_16 = Panel(polyline_to_points.PRINT_LENGTH)
crv_6 = Curve(polyline_to_points.MACHINE)
python_2 = GhPythonScript(POINTS=polyline_to_points.POINTS, DRAW=Toggle(True))  # -> out, DRAW_POINTS; inputs POINTS: list
# ---------- python_2: Python ----------
################################################################################
###                                                                          ###
###   GH_Gcode for TL                                                        ###
###                                                                          ###
###       Component : Points Render / 201123                                 ###
###                                                                          ###
###                                                                          ###
###   Base Script >>> GH_Gcode                                               ###
###                                                                          ###
###       Repository : https://github.com/naysok/GH_Gcode                    ###
###       Coding : naoki yoshioka (naysok)                                   ###
###       License : MIT License                                              ###
###                                                                          ###
################################################################################


import datetime
import math


class Util():


    def get_current_time(self):
        return str(datetime.datetime.now().strftime("%Y-%m-%d_%H-%M-%S"))


    def remap_number(self, src, old_min, old_max, new_min, new_max):
        return ((src - old_min) / (old_max - old_min) * (new_max - new_min) + new_min)


    def flatten_runtime_list(self, list):
        all = []
        
        for i in xrange(len(list)):
            # print(i)
            sub = list[i]
            for j in xrange(len(sub)):
                # print(j)
                all.append(sub[j])

        return all


    def export_gcode(self, dir_path, txt):

        now = self.get_current_time()
        file_path = dir_path + now + ".gcode"

        ### Export
        with open(file_path, 'w') as f:
            f.write(txt)

        print("Export GCode : {}".format(file_path))


    def zip_matrix(self, mat):
        ### https://note.nkmk.me/python-list-transpose/
        return [list(x) for x in zip(*mat)]


    def padding_previous_value(self, list_):
        
        list_pad = []

        for i in xrange(len(list_)):
            
            item_ = list_[i]

            ### First 
            if i == 0:
                if (item_ == None):
                    list_pad.append(0)
                else:
                    list_pad.append(item_)
            
            ### Not Frist
            else:
                if (item_ == None):
                    tmp = list_pad[i-1]
                    list_pad.append(tmp)
                else:
                    list_pad.append(item_)
        
        return list_pad


    def remove_previous_elements(self, a_list):

        ### Remove Same Element as the Previous One
        new_list = []
        src_length = len(a_list)

        for i in range(src_length):
            tmp = a_list[i]

            ### 
            if i < src_length-1:
                if a_list[i] != a_list[i+1]:
                    new_list.append(tmp)
            ### Last
            else:
                new_list.append(tmp)
                
        return new_list


    def bitwise_or_arrays(self, arrays):

        ### Merge Bool from Brep.isPointInside

        # print(len(arrays[0]))
        # print(len(arrays[0][0]))

        if len(arrays) == 1:
            return arrays[0]

        else:
            arrays_zip = self.zip_matrix(arrays)
            # print(len(arrays_zip))
            # print(len(arrays_zip[0]))
            # print(len(arrays_zip[0][0]))

            bool_inside = []

            for i in xrange(len(arrays_zip)):
                # print(i)

                sub_ = []

                item = arrays_zip[i]
                item_zip = self.zip_matrix(item)

                # print(len(item_zip))
                # print(len(item_zip[0]))

                for j in xrange(len(item_zip)):

                    values = item_zip[j]
                    
                    if True in values:
                        sub_.append(True)
                    else:
                        sub_.append(False)

                bool_inside.append(sub_)

            # print(len(bool_inside))
            # print(len(bool_inside[0]))

            return bool_inside

ut = Util()


##########

##########


ghenv.Component.Message = 'Points Render / 201123'


if __DRAW:
    __DRAW_POINTS = ut.flatten_runtime_list(POINTS)
# ---------- end python_2 ----------
# (2) Points to Gcode
python_3 = GhPythonScript(
    POINTS=polyline_to_points.POINTS,
    INFO=polyline_to_points.INFO,
    E_AMP=panel_7,
    E_RETRACT=panel_13,
    E_RETRACT_BACK=panel_14,
    FEED=panel_8,
    TEMP_NOZZLE=panel_9,
    TEMP_BED=panel_5,
    Z_BUFFER=panel_6,
    EXPORT_DIR=txt_2,
    RUN_AND_EXPORT=toggle)  # -> out, DEV; inputs POINTS: list
# ---------- python_3: Python ----------
################################################################################
###                                                                          ###
###   GH_Gcode for HW                                                        ###
###                                                                          ###
###       Component : (2) Points to gcode                                    ###
###                                                                          ###
###                                                                          ###
###   Base Script >>> GH_Gcode                                               ###
###                                                                          ###
###       Repository : https://github.com/naysok/GH_Gcode                    ###
###       Coding : naoki yoshioka (naysok)                                   ###
###       License : MIT License                                              ###
###                                                                          ###
###   Update, 210822 / dd Leveling)                                          ###
###   Update, 210826 / Add E_Retract)                                        ###
###   Update, 221128 / Bug_Fix for E_Retract                                 ###
###   Update, 221203 / Update E_Retract                                      ###
###                                                                          ###
################################################################################


import datetime
import math

import rhinoscriptsyntax as rs
import Rhino.Geometry as rg


class Util():


    def get_current_time(self):
        return str(datetime.datetime.now().strftime("%Y-%m-%d_%H-%M-%S"))


    def remap_number(self, src, old_min, old_max, new_min, new_max):
        return ((src - old_min) / (old_max - old_min) * (new_max - new_min) + new_min)


    def flatten_runtime_list(self, list):
        all = []
        
        for i in xrange(len(list)):
            # print(i)
            sub = list[i]
            for j in xrange(len(sub)):
                # print(j)
                all.append(sub[j])

        return all


    def export_gcode(self, dir_path, txt):

        now = self.get_current_time()
        file_path = dir_path + now + ".gcode"

        ### Export
        with open(file_path, 'w') as f:
            f.write(txt)

        print("Export GCode : {}".format(file_path))


    def zip_matrix(self, mat):
        ### https://note.nkmk.me/python-list-transpose/
        return [list(x) for x in zip(*mat)]


    def padding_previous_value(self, list_):
        
        list_pad = []

        for i in xrange(len(list_)):
            
            item_ = list_[i]

            ### First 
            if i == 0:
                if (item_ == None):
                    list_pad.append(0)
                else:
                    list_pad.append(item_)
            
            ### Not Frist
            else:
                if (item_ == None):
                    tmp = list_pad[i-1]
                    list_pad.append(tmp)
                else:
                    list_pad.append(item_)
        
        return list_pad


    def remove_previous_elements(self, a_list):

        ### Remove Same Element as the Previous One
        new_list = []
        src_length = len(a_list)

        for i in range(src_length):
            tmp = a_list[i]

            ### 
            if i < src_length-1:
                if a_list[i] != a_list[i+1]:
                    new_list.append(tmp)
            ### Last
            else:
                new_list.append(tmp)
                
        return new_list


    def bitwise_or_arrays(self, arrays):

        ### Merge Bool from Brep.isPointInside

        # print(len(arrays[0]))
        # print(len(arrays[0][0]))

        if len(arrays) == 1:
            return arrays[0]

        else:
            arrays_zip = self.zip_matrix(arrays)
            # print(len(arrays_zip))
            # print(len(arrays_zip[0]))
            # print(len(arrays_zip[0][0]))

            bool_inside = []

            for i in xrange(len(arrays_zip)):
                # print(i)

                sub_ = []

                item = arrays_zip[i]
                item_zip = self.zip_matrix(item)

                # print(len(item_zip))
                # print(len(item_zip[0]))

                for j in xrange(len(item_zip)):

                    values = item_zip[j]
                    
                    if True in values:
                        sub_.append(True)
                    else:
                        sub_.append(False)

                bool_inside.append(sub_)

            # print(len(bool_inside))
            # print(len(bool_inside[0]))

            return bool_inside

ut = Util()


class Transform():


    def pt_pt_add(self, pt0, pt1):
        pt = [
            float(pt1[0]) + float(pt0[0]),
            float(pt1[1]) + float(pt0[1]),
            float(pt1[2]) + float(pt0[2])]
        return pt


    def pt_pt_subtract(self, pt0, pt1):
        pt = [
            float(pt0[0]) - float(pt1[0]),
            float(pt0[1]) - float(pt1[1]),
            float(pt0[2]) - float(pt1[2])]
        return pt


    def vector_multiplicate(self, vector, value):
        vec = [
            float(vector[0]) * value,
            float(vector[1]) * value,
            float(vector[2]) * value]
        return vec


    def vector_unitize(self, vector):
        length = math.sqrt(
            math.pow(float(vector[0]), 2) + 
            math.pow(float(vector[1]), 2) + 
            math.pow(float(vector[2]), 2))
        new_vector = self.vector_multiplicate(vector, (1.0 / length))
        return new_vector


    def move_pt_vec(self, pt, vec):
        p = [
            float(pt[0]) + float(vec[0]),
            float(pt[1]) + float(vec[1]),
            float(pt[2]) + float(vec[2])]
        return p
        
tr = Transform()


class Curve():


    def polyline_to_points(self, polyline):

        ########## NEW CODE ##########

        ### Polyline to Points by RhinoCommon
        pl = rs.coercegeometry(polyline)
        new_pl = rg.PolylineCurve.ToPolyline(pl)
        points = new_pl.ToArray()

        ########## NEW CODE ##########

        """
        ########## OLD CODE 1 ##########
        ### Start-Point + CurveDiscontinuity + End-Point
        points = []
        ### Start Point
        start_pt = rs.CurveStartPoint(polyline)
        points.append(start_pt)
        ### Segment Points
        ### Style : 3 = C2 - Continuous first and second derivative
        segments = rs.CurveDiscontinuity(polyline, 3)
        for j in range(len(segments)):
            points.append(segments[j])
        ### End Point
        end_pt =  rs.CurveEndPoint(polyline)
        points.append(end_pt)
        ########## OLD CODE 1 ##########
        """

        """
        ########## OLD CODE 2 ##########
        
        ### Polyline to Points by rhinoscriptsuntax
        ### https://developer.rhino3d.com/api/RhinoScriptSyntax/#collapse-PolylineVertices
        
        points = rs.PolylineVertices(polyline)
        
        ########## OLD CODE 2 ##########
        """
        
        return points


    def polylines_to_points(self, polylines):

        points_array = []

        for i in xrange(len(polylines)):

            points = self.polyline_to_points(polylines[i])
            points_array.append(points)

        return points_array


    def offset_z_curves(self, curves, z_offset_value):

        move_vec = rs.CreateVector(0, 0, z_offset_value)
        geos_off = rs.MoveObjects(curves, move_vec)
        
        return geos_off

op_c = Curve()


class MarlinGcode():


    def define_msg(self):
        t0 = "; GH_Gcode for HW\n"
        t1 = "; Polyline to Gcode by Grasshopper\n"
        t2 = "; For Mariln 3D Printer\n"
        t = t0 + t1 + t2
        return t

    def define_print_parameter(self, component, e_amp, feed, temp_nozzle, temp_bed, fan, z_zuffer):
        
        line = "; ----- Print Parameter -----\n"

        ### Time Stamp
        now = ut.get_current_time()
        time = "; Export Time : {}\n".format(now)
        
        ### Print Parameter
        print_comp = "; Component Info : {}\n".format(component)
        print_e_amp = "; E_AMP : {}\n".format(str(e_amp))
        print_feed = "; FEED : {}\n".format(str(feed))
        print_temp_nozzle = "; TEMP_NOZZLE : {}\n".format(str(temp_nozzle))
        print_temp_bed = "; TEMP_BED : {}\n".format(str(temp_bed))
        print_fan = "; FAN : {}\n".format(str(fan))
        print_z_buffer = "; Z_BUFFER : {}\n".format(str(z_zuffer))
        
        print_prm = [line, time, print_comp, print_e_amp, print_feed, 
            print_temp_nozzle, print_temp_bed, print_fan, print_z_buffer, line]

        print_prm_join = "".join(print_prm)

        return print_prm_join


    def define_general_settings(self):

        ### G90 - Absolute Positioning
        set_g90 = "G90 ; Absolute Positioning\n"

        ### M82 - E Absolute Mode
        set_m82 = "M82 ; E Absolute Mode\n"

        ### Set Tool
        set_t0 = "T0\n"

        settings = [set_g90, set_m82, set_t0]
        
        settings_join = "".join(settings)

        return settings_join


    def start_fan(self, fan):
        
        ### M106 - Set Fan Speed
        set_fan = "M106 S{} ; Set - Fan\n".format(str(fan))
        return set_fan


    def start_bed(self, temp_bed):
        
        ### M140 - Set Bed Temperature
        ### M190 - Wait for Bed Temperature

        set_temp_bed = "M140 S{} ; Set - Temp Bed\n".format(str(temp_bed))

        if float(temp_bed) < 40:
            return set_temp_bed

        else:
            wait_temp_bed = "M190 S{} ; Wait - Temp Bed\n".format(str(temp_bed))
            return set_temp_bed + wait_temp_bed


    def start_extruder(self, temp_nozzle):

        ### M104 - Set Hotend Temperature
        ### M109 - Wait for Hotend Temperature
        
        set_temp_extruder = "M104 S{} T0 ; Set - Temp Extruder\n".format(str(temp_nozzle))
        wait_temp_extruder = "M109 S{} T0 ; Wait - Temp Extruder\n".format(str(temp_nozzle))

        return set_temp_extruder + wait_temp_extruder


    def homing_all_axes(self):
        
        ### G28 - Auto Home
        homing = "G28 ; Homing\n"
        return homing


    def homing_x(self):
        
        ### G28 - Auto Home
        homing = "G28 X0 ; Homing X\n"
        return homing

    
    def leveling(self):

        ### G29 - Auto Leveling
        leveling = "G29 ; Auto Leveling\n"
        return leveling


    def reset_extrude_value(self):

        ### G92 - Set Position
        reset_e = "G92 E0 ; Reset Extruder Value\n"
        return reset_e


    def calc_distance_2pt(self, x0, y0, z0, x1, y1, z1):

        ### Calc Distance
        xx = x0 - x1
        yy = y0 - y1
        zz = z0 - z1
        dist = math.sqrt((xx * xx) + (yy * yy) + (zz * zz))

        return dist


    ##################################################################


    #################################
    ###                           ###
    ###     Print Start / End     ###
    ###                           ###
    #################################


    def print_start_old(self, fan, temp_bed, temp_nozzle):

        start = []

        start.append("; ----- Start Code -----\n")

        ### General Setting
        start.append(self.define_general_settings())
        
        ### Start Fan
        start.append(self.start_fan(fan))

        ### Start Bed
        start.append(self.start_bed(temp_bed))

        ### Start Extruder
        start.append(self.start_extruder(temp_nozzle))

        ### Homing
        start.append(self.homing_all_axes())

        ### Reset Extruder Value
        start.append(self.reset_extrude_value())

        start.append("; ----- Start Code -----\n")

        start_join = "".join(start)

        return start_join


    def print_start(self, fan, temp_bed, temp_nozzle):
        
        ### Ref
        ### hineri_kazamatsuri.gcode

        start = []

        start.append("; ----- Start Code -----\n")

        ### General Setting
        start.append(self.define_general_settings())
        
        ### Start Fan
        start.append(self.start_fan(fan))

        ### Start Bed
        start.append(self.start_bed(temp_bed))

        ### Start Extruder
        start.append(self.start_extruder(temp_nozzle))

        ### Homing
        start.append(self.homing_all_axes())

        ### Leveling
        start.append(self.leveling())

        ### Reset Extruder Value
        start.append(self.reset_extrude_value())

        start.append("; ----- Start Code -----\n")

        ###

        start_join = "".join(start)

        return start_join


    def print_end(self):

        end = []

        end.append("; ----- End Code -----\n")

        ### Homing X
        end.append(self.homing_x())

        ### End Part
        end.append("M106 S0 ; turn off cooling fan\n")
        end.append("M104 S0 ; turn off extruder\n")
        end.append("M140 S0 ; turn off bed\n")
        end.append("M84 ; disable motors\n")

        end.append("; ----- End Code -----\n")

        end_join = "".join(end)

        return end_join
    

    ##################################################################


    ########################
    ###                  ###
    ###     Printing     ###
    ###                  ###
    ########################


    def travel(self, z_current, z_zuffer):

        ### Travel

        gcode = []

        comment = "; --- Travel ---\n"

        gz = str("{:.4f}".format(z_current + float(z_zuffer)))
        code_travel = "G1 Z{}\n".format(gz)

        ###

        gcode.append(comment)
        gcode.append(code_travel)
        gcode.append(comment)

        ###

        gcode_join = "".join(gcode)

        return gcode_join


    def retract(self, e_retract):

        ### E_Retract

        gcode = []

        comment = "; --- E_Retract ---\n"
        
        ### Reset Extruder Value
        code_reset = self.reset_extrude_value()
        
        v = str("{:.4f}".format(float(e_retract)))
        code_retract = "G0 E-{}\n".format(v)
        
        ###
        
        gcode.append(comment)
        gcode.append(code_reset)
        gcode.append(code_retract)
        gcode.append(code_reset)
        gcode.append(comment)

        ###

        gcode_join = "".join(gcode)

        return gcode_join


    def retract_back(self, e_retract_back):

        ### E_Retract_Back

        gcode = []

        comment = "; --- E_Retract_Back ---\n"

        ### Reset Extruder Value
        code_reset = self.reset_extrude_value()
        
        v = str("{:.4f}".format(float(e_retract_back)))
        code_retract_back = "G0 E{}\n".format(v)
 
        ###

        gcode.append(comment)
        gcode.append(code_reset)
        gcode.append(code_retract_back)
        gcode.append(code_reset)
        gcode.append(comment)

        ###

        gcode_join = "".join(gcode)

        return gcode_join


    def point_to_gcode(self, count, pts, e_amp, e_retract, e_retract_back, feed, z_zuffer):
        
        layer = []

        ### CR-10 / TPU
        PRINTER_PARAMETER = 0.165

        for i in xrange(len(pts)):
            p = pts[i]
            xx, yy, zz = p

            ### Index[0]
            if i == 0:

                ### Initialize
                ee = 0

                ### Layer Info (Comment)
                start_comment = "; ----- Layer : {} / start -----\n".format(count)
                layer.append(start_comment)

                ### Reset Extruder Value
                layer.append(self.reset_extrude_value())

                gx = str("{:.4f}".format(xx))
                gy = str("{:.4f}".format(yy))
                gz = str("{:.4f}".format(zz))
                gf = str("{}".format(feed))

                gcode = "G1 X{} Y{} Z{} E0 F{}\n".format(gx, gy, gz, gf)
                layer.append(gcode)

                if int(count) != 0:
                    ### E_Retract_Back
                    retract_back = self.retract_back(e_retract_back)
                    layer.append(retract_back)


            ### Index[1] - Index[Last]
            else:
                x0, y0, z0 = pts[i - 1]
                x1, y1, z1 = pts[i]
                
                distance = self.calc_distance_2pt(x0, y0, z0, x1, y1, z1)

                ### PRINTER_PARAMETER // 1.85 to 0.4
                ### e_amp // override
                ee += (distance * float(PRINTER_PARAMETER) * float(e_amp))

                gx = str("{:.4f}".format(xx))
                gy = str("{:.4f}".format(yy))
                gz = str("{:.4f}".format(zz))
                ge = str("{:.4f}".format(ee))
                
                gcode = "G1 X{} Y{} Z{} E{}\n".format(gx, gy, gz, ge)
                layer.append(gcode)
            
                ### Index[Last]
                if i == (len(pts) - 1):

                    ### E_Retract
                    retract = self.retract(e_retract)
                    layer.append(retract)

                    ### Travel
                    travel = self.travel(zz, z_zuffer)
                    layer.append(travel)

                    ### Layer Info (Comment)
                    end_comment = "; ----- Layer : {} / end -----\n".format(count)
                    layer.append(end_comment)

        ### Join
        layer_join = "".join(layer)

        return layer_join


    ##################################################################


    ##############################
    ###                        ###
    ###     Generate Gcode     ###
    ###                        ###
    ##############################


    def points_list_to_gcode(self, points_list, component, e_amp, e_retract, e_retract_back, feed, temp_nozzle, temp_bed, fan, z_zuffer):
        
        ### RUN ALL
        export = []

        ### Msg, Parameters
        export.append(self.define_msg())
        export.append(self.define_print_parameter(component, e_amp, feed, temp_nozzle, temp_bed, fan, z_zuffer))

        ### Print Start
        # export.append(self.print_start(fan, temp_bed, temp_nozzle))
        export.append(self.print_start(fan, temp_bed, temp_nozzle))

        
        ### Printing
        for i in xrange(len(points_list)):

            pts = points_list[i]
            layer_count = str(i)
            export.append(self.point_to_gcode(layer_count, pts, e_amp, e_retract, e_retract_back, feed, z_zuffer))

        ### Print End
        export.append(self.print_end())


        ### JOIN
        export_join = "".join(export)

        return export_join


op_ml = MarlinGcode()



##########

##########


BUILD_DAY = "221203"


ghenv.Component.Message = "2) Points to gcode / {}".format(BUILD_DAY)
comp_info = "ver_{}".format(BUILD_DAY)


Z_OFFSET_VALUE = INFO
FAN = 0


### Points to Gcode (Not Go Through Machine Origin)
if RUN_AND_EXPORT:
    gcode = op_ml.points_list_to_gcode(POINTS, comp_info, E_AMP, E_RETRACT, E_RETRACT_BACK, FEED, TEMP_NOZZLE, TEMP_BED, FAN, Z_BUFFER)
    ut.export_gcode(EXPORT_DIR, gcode)
# ---------- end python_3 ----------
panel_17 = Panel(python_3.out)
