# Grasshopper definition gh_gcode_221231.ghx (Grasshopper 1.0.7)

brep = Brep([<brep referenced from the Rhino model> x74])

# ---- group: Layer Height
number_slider = Slider(0.15, range=0..1)

# ---- group: Test Breps
# 221231 - GH_Gcode for HW
# 
# Workflow
# (0) Brep to Polylines
# (1) Polylines to Points
# (2) Points to Gcode
# (0) Brep to Polylines
brep_2 = Brep([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])

# ----
viewer = ParamViewer(brep)
panel = Panel("C:\Users\ysoky\Documents\FabCafe\GH_Gcode_for_TL\_result\2021-08-22_17-31-45.gcode")

# ---- group: ex) Windows
panel_2 = Panel("C:\Users\ysoky\Documents\FabCafe\GH_Gcode_for_TL\_test\210814_test.gcode")

# ---- group: ex) MacOS
# Gcode Viewer ( Gcode to Polyline )
panel_3 = Panel("/Users/yoshionao_mbp/Documents/FabCafe/GH_Gcode_for_TL/_test/210814_test.gcode")

# ---- group: (0) Breps to Polyline / INPUT : Breps
brep_3 = Brep(brep_2)

# ----
txt = Text(panel)
python = GhPythonScript(PATH=txt)  # -> out, MOVE, a
# ---------- python: Python ----------
################################################################################
###                                                                          ###
###   GH_Gcode for TL                                                        ###
###                                                                          ###
###       Component : Viewer_Marlin / 210822                                 ###
###                                                                          ###
###                                                                          ###
###   Base Script >>> GH_Gcode                                               ###
###                                                                          ###
###       Repository : https://github.com/naysok/GH_Gcode                    ###
###       Coding : naoki yoshioka (naysok)                                   ###
###       License : MIT License                                              ###
###                                                                          ###
###   Update, 210822 / ysok (G29)                                            ###
###                                                                          ###
################################################################################


import datetime
import math

import rhinoscriptsyntax as rs
import Rhino.Geometry as rg


class Util():


    def get_current_time(self):
        return str(datetime.datetime.now().strftime("%Y-%m-%d_%H-%M-%S"))


    def remap_number(self, src, old_min, old_max, new_min, new_max):
        return ((src - old_min) / (old_max - old_min) * (new_max - new_min) + new_min)


    def flatten_runtime_list(self, list):
        all = []
        
        for i in xrange(len(list)):
            # print(i)
            sub = list[i]
            for j in xrange(len(sub)):
                # print(j)
                all.append(sub[j])

        return all


    def export_gcode(self, dir_path, txt):

        now = self.get_current_time()
        file_path = dir_path + now + ".gcode"

        ### Export
        with open(file_path, 'w') as f:
            f.write(txt)

        print("Export GCode : {}".format(file_path))


    def zip_matrix(self, mat):
        ### https://note.nkmk.me/python-list-transpose/
        return [list(x) for x in zip(*mat)]


    def padding_previous_value(self, list_):
        
        list_pad = []

        for i in xrange(len(list_)):
            
            item_ = list_[i]

            ### First 
            if i == 0:
                if (item_ == None):
                    list_pad.append(0)
                else:
                    list_pad.append(item_)
            
            ### Not Frist
            else:
                if (item_ == None):
                    tmp = list_pad[i-1]
                    list_pad.append(tmp)
                else:
                    list_pad.append(item_)
        
        return list_pad


    def remove_previous_elements(self, a_list):

        ### Remove Same Element as the Previous One
        new_list = []
        src_length = len(a_list)

        for i in range(src_length):
            tmp = a_list[i]

            ### 
            if i < src_length-1:
                if a_list[i] != a_list[i+1]:
                    new_list.append(tmp)
            ### Last
            else:
                new_list.append(tmp)
                
        return new_list


    def bitwise_or_arrays(self, arrays):

        ### Merge Bool from Brep.isPointInside

        # print(len(arrays[0]))
        # print(len(arrays[0][0]))

        if len(arrays) == 1:
            return arrays[0]

        else:
            arrays_zip = self.zip_matrix(arrays)
            # print(len(arrays_zip))
            # print(len(arrays_zip[0]))
            # print(len(arrays_zip[0][0]))

            bool_inside = []

            for i in xrange(len(arrays_zip)):
                # print(i)

                sub_ = []

                item = arrays_zip[i]
                item_zip = self.zip_matrix(item)

                # print(len(item_zip))
                # print(len(item_zip[0]))

                for j in xrange(len(item_zip)):

                    values = item_zip[j]
                    
                    if True in values:
                        sub_.append(True)
                    else:
                        sub_.append(False)

                bool_inside.append(sub_)

            # print(len(bool_inside))
            # print(len(bool_inside[0]))

            return bool_inside

ut = Util()


################################################################################


class ViewerMarlin():
    
    
    def open_file(self, path):
        with open(path) as f:
            l = f.readlines()
        # print(type(l))
        # print(len(l))
        # print(l)
        return l


    def get_value_move(self, str_):
        
        ### Split Elements
        ### Remove n
        str_.replace("\n", "")
        
        ### Remove Comments
        if ";" in str_:
            str_rm_comment = str_.split(";")
            new_str = str_rm_comment[0]
        else:
            new_str = str_

        ### Gcode (per Line)
        # print(new_str)

        ### Split Space
        elements = new_str.split()

        ### init
        xx = None
        yy = None
        zz = None
        ee = None
        
        for i in xrange(len(elements)):
            elm = elements[i]

            ### Get Value
            if ("X" in elm):
                tmp_x = elm.split("X")
                xx = float(tmp_x[1])
            
            elif ("Y" in elm):
                tmp_y = elm.split("Y")
                yy = float(tmp_y[1])
            
            elif ("Z" in elm):
                tmp_z = elm.split("Z")
                zz = float(tmp_z[1])

            elif ("E" in elm):
                tmp_e = elm.split("E")
                ee = float(tmp_e[1])

        return [xx, yy, zz, ee]


    def gcode_operate_move(self, gcode_line):

        none_list = [None, None, None, None]

        ### Move
        if ("G0" in gcode_line) or \
            ("G1" in gcode_line) or \
            ("G00" in gcode_line) or \
            ("G01" in gcode_line) or \
            ("G92 E0" in gcode_line):
            ### get position
            return self.get_value_move(gcode_line)

        ### Commment Out
        elif (";" in gcode_line[0]) or (gcode_line == "\n"):
            return none_list

        ### Setting G
        elif ("G4" in gcode_line) or \
            ("G04" in gcode_line) or \
            ("G21" in gcode_line) or \
            ("G28" in gcode_line) or \
            ("G29" in gcode_line) or \
            ("G90" in gcode_line) or \
            ("G91" in gcode_line) or \
            ("G92" in gcode_line):
            
            return none_list

        ### Setting M
        elif ("M82" in gcode_line) or \
            ("M84" in gcode_line) or \
            ("M104" in gcode_line) or \
            ("M106" in gcode_line) or \
            ("M107" in gcode_line) or \
            ("M109" in gcode_line) or \
            ("M140" in gcode_line) or \
            ("M190" in gcode_line) or \
            ("M204" in gcode_line) or \
            ("M205" in gcode_line):

            return none_list
        
        ### Setting T
        elif ("T0" in gcode_line) or \
            ("T1" in gcode_line):
            return none_list

        else:
            # return none_list
            return "bug!"


    def gcode_to_array(self, path):

        ### open gcode
        gcode = self.open_file(path)

        ### Get Vaules from gcode
        values = []
        for i in xrange(len(gcode)):
            gcode_line = gcode[i]

            ### XYZE
            elements = self.gcode_operate_move(gcode_line)

            ## DEBUG ALL
            # print(i, gcode_line)
            ### DEBUG bug
            if (elements == "bug!"):
                print(i, gcode_line)
            ## DEBUG

            values.append(elements)

        ### Padding Previous Value(None)
        values_zip = ut.zip_matrix(values)
        # print(len(values_zip))
        new_values = []
        for j in xrange(len(values_zip)):
            list_ = values_zip[j]
            list_pad = ut.padding_previous_value(list_)
            new_values.append(list_pad)
        gcode_values = ut.zip_matrix(new_values)

        # print(len(values))
        # print(len(gcode_values), len(gcode_values[0]))

        return gcode_values


    def segment_extrude(self, xyze):

        ### Segment Print / Travel
        ### https://docs.google.com/spreadsheets/d/1S4SQ-NT09Nh8sb3Lg6FSauKB1rZPMwLSDjvnrKerXFs/edit?usp=sharing
        array_seg = []
        list_seg = []

        for j in xrange(len(xyze)):

            xxx, yyy, zzz, eee = xyze[j]
            item = [xxx, yyy, zzz]
            
            # print(j)
            # print(j, xyze[j])

            ### Index[0]
            if (j == 0):
                
                x1, y1, z1, e1 = xyze[j]
                x2, y2, z2, e2 = xyze[j + 1]

                bool_b = e1 < e2

                if (bool_b == True):
                    list_seg = []
                    list_seg.append(item)
                
            ### Index[0] - Index[Last - 1]
            elif (j > 0) and (j < (len(xyze) - 1)):

                x0, y0, z0, e0 = xyze[j - 1]
                x1, y1, z1, e1 = xyze[j]
                x2, y2, z2, e2 = xyze[j + 1]

                bool_a = e0 < e1
                bool_b = e1 < e2

                if (bool_a == False) and (bool_b == True):
                    list_seg = []
                    list_seg.append(item)

                elif (bool_a == True) and (bool_b == True):
                    list_seg.append(item)

                elif (bool_a == True) and (bool_b == False):
                    list_seg.append(item)
                    array_seg.append(list_seg)

                elif (bool_a == False) and (bool_b == False):
                    pass

                else:
                    print("Error!!")
            
            ### Index[Last]
            elif (j == (len(xyze) - 1)):
                
                x0, y0, z0, e0 = xyze[j - 1]
                x1, y1, z1, e1 = xyze[j]

                bool_a = e0 < e1
                
                if (bool_a == True):
                    list_seg.append(item)
                    array_seg.append(list_seg)

        # print(array_out)

        return array_seg


    def remove_invalid_polylines(self, array_seg):

        ### Remove Invalid Polylines (Remove Same Element as the Previous One)
        layers = []

        for k in xrange(len(array_seg)):
            tmp_layer = array_seg[k]
            tmp_removed = ut.remove_previous_elements(tmp_layer)
            
            if len(tmp_removed) != 1:
                layers.append(tmp_removed)

        return layers


    def draw_path(self, values_4):

        ### Remove Same Element as the Previous One
        xyze = ut.remove_previous_elements(values_4)
        ### print(len(values_4), len(xyze))

        ### Segment Print / Travel
        array_seg = self.segment_extrude(xyze)

        ### Remove Invalid Polylines (Remove Same Element as the Previous One)
        layers = self.remove_invalid_polylines(array_seg)

        """
        ### Draw All Path
        pts = []
        for i in xrange(len(xyze)):
            x, y, z, e = values_4[i]
            pt = [x, y, z]
            pts.append(pt)
        """

        return layers


vm = ViewerMarlin()


################################################################################


ghenv.Component.Message = 'Viewer_Marlin / 210822'


print(PATH)

### gcode-file to Memory
xyze = vm.gcode_to_array(PATH)


### Pick Values
xyz = vm.draw_path(xyze)


### Draw Printing
layers = []
for layer_num in xrange(len(xyz)):
    layer_tmp = xyz[layer_num]
    pl = rs.AddPolyline(layer_tmp)
    # print(pl)
    layers.append(pl)


MOVE = layers
# ---------- end python ----------
lng = ListLength(List=python.out)

# ---- group: Render with Sequence
disc = Discontinuity(Curve=python.MOVE, Level=1)  # -> Points, Parameters
flatten = FlattenTree(Tree=disc.Points, Path="{0}")
lng_2 = ListLength(List=flatten)
multiplication = Multiplication(A=lng_2, B=Slider(0.038, range=0..1))
split = SplitList(List=flatten, Index=multiplication)  # -> ListA, ListB
pline = PolyLine(Vertices=split.ListA, Closed=False)

# ----
crv = Curve(python.MOVE)
panel_4 = Panel(lng)

# ---- group: Curve_from_Simplify3d
crv_2 = Curve([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])

# ---- group: Input Polyline
# (1) Polylines to Points
crv_3 = Curve(crv_2)

# ---- group: Export
toggle = BooleanToggle(False)

# ---- group: TEMP_NOZZLE
# Temperature
panel_5 = Panel("230")

# ---- group: TEMP_BED
panel_6 = Panel("60")

# ---- group: ex) Windows
panel_7 = Panel("C:\Users\ysoky\Documents\FabCafe\GH_Gcode_for_TL\_result\")

# ---- group: ex) MacOS
panel_8 = Panel("/Users/yoshionao_mbp/Documents/FabCafe/GH_Gcode_for_TL/_result/")

# ---- group: Z_OFFSET
panel_9 = Panel("0")

# ---- group: E_RETRACT
# Extrude
panel_10 = Panel("0.2")

# ---- group: E_AMP (Ratio)
panel_11 = Panel("1.0")

# ---- group: E_RETRACT_BACK
panel_12 = Panel("0.3")

# ---- group: Z_Buffer (Z_Escape)
# Disabled in Code.
panel_13 = Panel("0")

# ----
polyline_to_points = GhPythonScript(POLYLINES=crv_3, Z_OFFSET_VALUE=panel_9)  # -> PRINT_CURVES, PRINT_LENGTH, MACHINE, POINTS, INFO; inputs POLYLINES: list
# ---------- polyline_to_points: Python ----------
################################################################################
###                                                                          ###
###   GH_Gcode for TL                                                        ###
###                                                                          ###
###       Component : (1) Polyline to Points / 201123                        ###
###                                                                          ###
###                                                                          ###
###   Base Script >>> GH_Gcode                                               ###
###                                                                          ###
###       Repository : https://github.com/naysok/GH_Gcode                    ###
###       Coding : naoki yoshioka (naysok)                                   ###
###       License : MIT License                                              ###
###                                                                          ###
################################################################################



import math

import rhinoscriptsyntax as rs
import Rhino.Geometry as rg


class Util():


    def get_current_time(self):
        return str(datetime.datetime.now().strftime("%Y-%m-%d_%H-%M-%S"))


    def remap_number(self, src, old_min, old_max, new_min, new_max):
        return ((src - old_min) / (old_max - old_min) * (new_max - new_min) + new_min)


    def flatten_runtime_list(self, list):
        all = []
        
        for i in xrange(len(list)):
            # print(i)
            sub = list[i]
            for j in xrange(len(sub)):
                # print(j)
                all.append(sub[j])

        return all


    def export_gcode(self, dir_path, txt):

        now = self.get_current_time()
        file_path = dir_path + now + ".gcode"

        ### Export
        with open(file_path, 'w') as f:
            f.write(txt)

        print("Export GCode : {}".format(file_path))


    def zip_matrix(self, mat):
        ### https://note.nkmk.me/python-list-transpose/
        return [list(x) for x in zip(*mat)]


    def padding_previous_value(self, list_):
        
        list_pad = []

        for i in xrange(len(list_)):
            
            item_ = list_[i]

            ### First 
            if i == 0:
                if (item_ == None):
                    list_pad.append(0)
                else:
                    list_pad.append(item_)
            
            ### Not Frist
            else:
                if (item_ == None):
                    tmp = list_pad[i-1]
                    list_pad.append(tmp)
                else:
                    list_pad.append(item_)
        
        return list_pad


    def remove_previous_elements(self, a_list):

        ### Remove Same Element as the Previous One
        new_list = []
        src_length = len(a_list)

        for i in range(src_length):
            tmp = a_list[i]

            ### 
            if i < src_length-1:
                if a_list[i] != a_list[i+1]:
                    new_list.append(tmp)
            ### Last
            else:
                new_list.append(tmp)
                
        return new_list


    def bitwise_or_arrays(self, arrays):

        ### Merge Bool from Brep.isPointInside

        # print(len(arrays[0]))
        # print(len(arrays[0][0]))

        if len(arrays) == 1:
            return arrays[0]

        else:
            arrays_zip = self.zip_matrix(arrays)
            # print(len(arrays_zip))
            # print(len(arrays_zip[0]))
            # print(len(arrays_zip[0][0]))

            bool_inside = []

            for i in xrange(len(arrays_zip)):
                # print(i)

                sub_ = []

                item = arrays_zip[i]
                item_zip = self.zip_matrix(item)

                # print(len(item_zip))
                # print(len(item_zip[0]))

                for j in xrange(len(item_zip)):

                    values = item_zip[j]
                    
                    if True in values:
                        sub_.append(True)
                    else:
                        sub_.append(False)

                bool_inside.append(sub_)

            # print(len(bool_inside))
            # print(len(bool_inside[0]))

            return bool_inside

ut = Util()


class Transform():


    def pt_pt_add(self, pt0, pt1):
        pt = [
            float(pt1[0]) + float(pt0[0]),
            float(pt1[1]) + float(pt0[1]),
            float(pt1[2]) + float(pt0[2])]
        return pt


    def pt_pt_subtract(self, pt0, pt1):
        pt = [
            float(pt0[0]) - float(pt1[0]),
            float(pt0[1]) - float(pt1[1]),
            float(pt0[2]) - float(pt1[2])]
        return pt


    def vector_multiplicate(self, vector, value):
        vec = [
            float(vector[0]) * value,
            float(vector[1]) * value,
            float(vector[2]) * value]
        return vec


    def vector_unitize(self, vector):
        length = math.sqrt(
            math.pow(float(vector[0]), 2) + 
            math.pow(float(vector[1]), 2) + 
            math.pow(float(vector[2]), 2))
        new_vector = self.vector_multiplicate(vector, (1.0 / length))
        return new_vector


    def move_pt_vec(self, pt, vec):
        p = [
            float(pt[0]) + float(vec[0]),
            float(pt[1]) + float(vec[1]),
            float(pt[2]) + float(vec[2])]
        return p

tr = Transform()


class Curve():


    def polyline_to_points(self, polyline):

        ########## NEW CODE ##########

        ### Polyline to Points by RhinoCommon
        pl = rs.coercegeometry(polyline)
        new_pl = rg.PolylineCurve.ToPolyline(pl)
        points = new_pl.ToArray()

        ########## NEW CODE ##########

        """
        ########## OLD CODE 1 ##########
        ### Start-Point + CurveDiscontinuity + End-Point
        points = []
        ### Start Point
        start_pt = rs.CurveStartPoint(polyline)
        points.append(start_pt)
        ### Segment Points
        ### Style : 3 = C2 - Continuous first and second derivative
        segments = rs.CurveDiscontinuity(polyline, 3)
        for j in range(len(segments)):
            points.append(segments[j])
        ### End Point
        end_pt =  rs.CurveEndPoint(polyline)
        points.append(end_pt)
        ########## OLD CODE 1 ##########
        """

        """
        ########## OLD CODE 2 ##########
        
        ### Polyline to Points by rhinoscriptsuntax
        ### https://developer.rhino3d.com/api/RhinoScriptSyntax/#collapse-PolylineVertices
        
        points = rs.PolylineVertices(polyline)
        
        ########## OLD CODE 2 ##########
        """
        
        return points


    def polylines_to_points(self, polylines):

        points_array = []

        for i in xrange(len(polylines)):

            points = self.polyline_to_points(polylines[i])
            points_array.append(points)

        return points_array


    def offset_z_curves(self, curves, z_offset_value):

        move_vec = rs.CreateVector(0, 0, z_offset_value)
        geos_off = rs.MoveObjects(curves, move_vec)
        
        return geos_off

op_c = Curve()


##########

##########


ghenv.Component.Message = '(1) Polyline to Points / 201123'


### Z OFFSET
offset_curves = op_c.offset_z_curves(POLYLINES, Z_OFFSET_VALUE)
#DEV = offset_curves
INFO = Z_OFFSET_VALUE


### Polylines to Points
pts = op_c.polylines_to_points(offset_curves)
POINTS = pts


def print_preview(points_array):

    pls = []
    lens_ = 0.0

    for i in xrange(len(points_array)):
        pl = rg.Polyline(points_array[i])
        pls.append(pl)
        
        len_ = pl.Length
        lens_ += float(len_)
        
    lens_int = int(lens_)

    return pls, lens_int

def draw_machine(w, h):
    rc = rs.AddRectangle(rs.WorldXYPlane(), w, h)
    return rc


### Print Preview

print_crvs, print_len = print_preview(pts)
__PRINT_CURVES = print_crvs
__PRINT_LENGTH = print_len


### Draw Machine
MACHINE = draw_machine(400, 400)
# ---------- end polyline_to_points ----------

# ---- group: F_PRINT
panel_14 = Panel("480")

# ---- group: F_RETRACT
# Feed
panel_15 = Panel("2400")

# ---- group: F_TRAVEL
panel_16 = Panel("4800")

# ---- group: DEV PATH
panel_17 = Panel("C:\Users\SJ018\Desktop\GH_Gcode_for_HW\_py\2_points_to_gcode.py")

# ----
txt_2 = Text("C:\Users\SJ018\Desktop\GH_Gcode_for_TL\_result\")
panel_19 = Panel(polyline_to_points.INFO)
panel_20 = Panel(polyline_to_points.PRINT_LENGTH)
crv_4 = Curve(polyline_to_points.MACHINE)
python_2 = GhPythonScript(POINTS=polyline_to_points.POINTS, DRAW=Toggle(True))  # -> out, DRAW_POINTS; inputs POINTS: list
# ---------- python_2: Python ----------
################################################################################
###                                                                          ###
###   GH_Gcode for TL                                                        ###
###                                                                          ###
###       Component : Points Render / 201123                                 ###
###                                                                          ###
###                                                                          ###
###   Base Script >>> GH_Gcode                                               ###
###                                                                          ###
###       Repository : https://github.com/naysok/GH_Gcode                    ###
###       Coding : naoki yoshioka (naysok)                                   ###
###       License : MIT License                                              ###
###                                                                          ###
################################################################################


import datetime
import math


class Util():


    def get_current_time(self):
        return str(datetime.datetime.now().strftime("%Y-%m-%d_%H-%M-%S"))


    def remap_number(self, src, old_min, old_max, new_min, new_max):
        return ((src - old_min) / (old_max - old_min) * (new_max - new_min) + new_min)


    def flatten_runtime_list(self, list):
        all = []
        
        for i in xrange(len(list)):
            # print(i)
            sub = list[i]
            for j in xrange(len(sub)):
                # print(j)
                all.append(sub[j])

        return all


    def export_gcode(self, dir_path, txt):

        now = self.get_current_time()
        file_path = dir_path + now + ".gcode"

        ### Export
        with open(file_path, 'w') as f:
            f.write(txt)

        print("Export GCode : {}".format(file_path))


    def zip_matrix(self, mat):
        ### https://note.nkmk.me/python-list-transpose/
        return [list(x) for x in zip(*mat)]


    def padding_previous_value(self, list_):
        
        list_pad = []

        for i in xrange(len(list_)):
            
            item_ = list_[i]

            ### First 
            if i == 0:
                if (item_ == None):
                    list_pad.append(0)
                else:
                    list_pad.append(item_)
            
            ### Not Frist
            else:
                if (item_ == None):
                    tmp = list_pad[i-1]
                    list_pad.append(tmp)
                else:
                    list_pad.append(item_)
        
        return list_pad


    def remove_previous_elements(self, a_list):

        ### Remove Same Element as the Previous One
        new_list = []
        src_length = len(a_list)

        for i in range(src_length):
            tmp = a_list[i]

            ### 
            if i < src_length-1:
                if a_list[i] != a_list[i+1]:
                    new_list.append(tmp)
            ### Last
            else:
                new_list.append(tmp)
                
        return new_list


    def bitwise_or_arrays(self, arrays):

        ### Merge Bool from Brep.isPointInside

        # print(len(arrays[0]))
        # print(len(arrays[0][0]))

        if len(arrays) == 1:
            return arrays[0]

        else:
            arrays_zip = self.zip_matrix(arrays)
            # print(len(arrays_zip))
            # print(len(arrays_zip[0]))
            # print(len(arrays_zip[0][0]))

            bool_inside = []

            for i in xrange(len(arrays_zip)):
                # print(i)

                sub_ = []

                item = arrays_zip[i]
                item_zip = self.zip_matrix(item)

                # print(len(item_zip))
                # print(len(item_zip[0]))

                for j in xrange(len(item_zip)):

                    values = item_zip[j]
                    
                    if True in values:
                        sub_.append(True)
                    else:
                        sub_.append(False)

                bool_inside.append(sub_)

            # print(len(bool_inside))
            # print(len(bool_inside[0]))

            return bool_inside

ut = Util()


##########

##########


ghenv.Component.Message = 'Points Render / 201123'


if __DRAW:
    __DRAW_POINTS = ut.flatten_runtime_list(POINTS)
# ---------- end python_2 ----------
txt_3 = Text(panel_17)
# (2) Points to Gcode
# Release Ver
# ---
# Program is internalized.
python_3 = GhPythonScript(
    POINTS=polyline_to_points.POINTS,
    INFO=polyline_to_points.INFO,
    E_AMP=panel_11,
    E_RETRACT=panel_10,
    E_RETRACT_BACK=panel_12,
    FEED_PRINT=panel_14,
    FEED_RETRACT=panel_15,
    FEED_TRAVEL=panel_16,
    TEMP_NOZZLE=panel_5,
    TEMP_BED=panel_6,
    Z_BUFFER=panel_13,
    EXPORT_DIR=txt_2,
    RUN_AND_EXPORT=toggle)  # -> out, DEV; inputs POINTS: list
# ---------- python_3: Python ----------
################################################################################
###                                                                          ###
###   GH_Gcode for HW                                                        ###
###                                                                          ###
###       Component : (2) Points to gcode                                    ###
###                                                                          ###
###                                                                          ###
###   Base Script >>> GH_Gcode                                               ###
###                                                                          ###
###       Repository : https://github.com/naysok/GH_Gcode                    ###
###       Coding : naoki yoshioka (naysok)                                   ###
###       License : MIT License                                              ###
###                                                                          ###
###   Update, 210822 / dd Leveling)                                          ###
###   Update, 210826 / Add E_Retract)                                        ###
###   Update, 221128 / Bug_Fix for E_Retract                                 ###
###   Update, 221203 / Update E_Retract                                      ###
###   Update, 221231 / Simplify3d's Travel                                   ###
###                                                                          ###
################################################################################


import datetime
import math

import rhinoscriptsyntax as rs
import Rhino.Geometry as rg


class Util():

    @staticmethod
    def get_current_time():
        return str(datetime.datetime.now().strftime("%Y-%m-%d_%H-%M-%S"))

    @staticmethod
    def remap_number(src, old_min, old_max, new_min, new_max):
        return ((src - old_min) / (old_max - old_min) * (new_max - new_min) + new_min)

    @staticmethod
    def flatten_runtime_list(list_):
        all_ = []
        
        for i in xrange(len(list_)):
            # print(i)
            sub = list_[i]
            for j in xrange(len(sub)):
                # print(j)
                all_.append(sub[j])

        return all_

    @staticmethod
    def export_gcode(dir_path, now, txt):

        file_path = dir_path + now + ".gcode"

        ### Export
        with open(file_path, 'w') as f:
            f.write(txt)

        print("********************\n*** Export GCode ***\n********************\n{}".format(file_path))

    @staticmethod
    def zip_matrix(mat):
        ### https://note.nkmk.me/python-list-transpose/
        return [list(x) for x in zip(*mat)]

    @staticmethod
    def padding_previous_value(list_):
        
        list_pad = []

        for i in xrange(len(list_)):
            
            item_ = list_[i]

            ### First 
            if i == 0:
                if (item_ == None):
                    list_pad.append(0)
                else:
                    list_pad.append(item_)
            
            ### Not Frist
            else:
                if (item_ == None):
                    tmp = list_pad[i-1]
                    list_pad.append(tmp)
                else:
                    list_pad.append(item_)
        
        return list_pad

    @staticmethod
    def remove_previous_elements(a_list):

        ### Remove Same Element as the Previous One
        new_list = []
        src_length = len(a_list)

        for i in range(src_length):
            tmp = a_list[i]

            ### 
            if i < src_length-1:
                if a_list[i] != a_list[i+1]:
                    new_list.append(tmp)
            ### Last
            else:
                new_list.append(tmp)
                
        return new_list

    @staticmethod
    def bitwise_or_arrays(arrays):

        ### Merge Bool from Brep.isPointInside

        # print(len(arrays[0]))
        # print(len(arrays[0][0]))

        if len(arrays) == 1:
            return arrays[0]

        else:
            arrays_zip = self.zip_matrix(arrays)
            # print(len(arrays_zip))
            # print(len(arrays_zip[0]))
            # print(len(arrays_zip[0][0]))

            bool_inside = []

            for i in xrange(len(arrays_zip)):
                # print(i)

                sub_ = []

                item = arrays_zip[i]
                item_zip = self.zip_matrix(item)

                # print(len(item_zip))
                # print(len(item_zip[0]))

                for j in xrange(len(item_zip)):

                    values = item_zip[j]
                    
                    if True in values:
                        sub_.append(True)
                    else:
                        sub_.append(False)

                bool_inside.append(sub_)

            # print(len(bool_inside))
            # print(len(bool_inside[0]))

            return bool_inside


class Transform():


    def pt_pt_add(self, pt0, pt1):
        pt = [
            float(pt1[0]) + float(pt0[0]),
            float(pt1[1]) + float(pt0[1]),
            float(pt1[2]) + float(pt0[2])]
        return pt


    def pt_pt_subtract(self, pt0, pt1):
        pt = [
            float(pt0[0]) - float(pt1[0]),
            float(pt0[1]) - float(pt1[1]),
            float(pt0[2]) - float(pt1[2])]
        return pt


    def vector_multiplicate(self, vector, value):
        vec = [
            float(vector[0]) * value,
            float(vector[1]) * value,
            float(vector[2]) * value]
        return vec


    def vector_unitize(self, vector):
        length = math.sqrt(
            math.pow(float(vector[0]), 2) + 
            math.pow(float(vector[1]), 2) + 
            math.pow(float(vector[2]), 2))
        new_vector = self.vector_multiplicate(vector, (1.0 / length))
        return new_vector


    def move_pt_vec(self, pt, vec):
        p = [
            float(pt[0]) + float(vec[0]),
            float(pt[1]) + float(vec[1]),
            float(pt[2]) + float(vec[2])]
        return p
        
tr = Transform()


class Curve():


    def polyline_to_points(self, polyline):

        ### Polyline to Points by RhinoCommon
        pl = rs.coercegeometry(polyline)
        new_pl = rg.PolylineCurve.ToPolyline(pl)
        points = new_pl.ToArray()
        
        return points


    def polylines_to_points(self, polylines):

        points_array = []

        for i in xrange(len(polylines)):

            points = self.polyline_to_points(polylines[i])
            points_array.append(points)

        return points_array


    def offset_z_curves(self, curves, z_offset_value):

        move_vec = rs.CreateVector(0, 0, z_offset_value)
        geos_off = rs.MoveObjects(curves, move_vec)
        
        return geos_off

op_c = Curve()


################################################################


class CalcVector():

    @staticmethod
    def calc_distance_2pt(x0, y0, z0, x1, y1, z1):

        d = math.sqrt(
            ((x0 - x1) * (x0 - x1)) + 
            ((y0 - y1) * (y0 - y1)) + 
            ((z0 - z1) * (z0 - z1)))

        return d


################################################################


class ParametersExtrude():

    def __init__(self, extrude_amp=None, extrude_retract=None, extrude_retract_back=None):
        
        self.extrude_amp = extrude_amp
        self.extrude_retract = extrude_retract
        self.extrude_retract_back = extrude_retract_back

    def define_print_parameter(self):
        
        ### For Header
        gcode_extrude_amp =          "; EXTRUDE_AMP, ratio       : {}\n".format(str(self.extrude_amp))
        gcode_extrude_retract =      "; EXTRUDE_RETRACT, mm      : {}\n".format(str(self.extrude_retract))
        gcode_extrude_retract_back = "; EXTRUDE_RETRACT_BACK, mm : {}\n".format(str(self.extrude_retract_back))

        gcode_extrude_parameter = gcode_extrude_amp + gcode_extrude_retract + gcode_extrude_retract_back

        return gcode_extrude_parameter


class ParametersFeed():

    def __init__(self, feed_print=None, feed_retract=None, feed_travel=None):
        
        self.feed_print = feed_print
        self.feed_retract = feed_retract
        self.feed_travel = feed_travel

    def define_print_parameter(self):
            
        ### For Header
        gcode_feed_print =   "; FEED_PRINT   : {}\n".format(str(self.feed_print))
        gcode_feed_retract = "; FEED_RETRACT : {}\n".format(str(self.feed_retract))
        gcode_feed_travel =  "; FEED_TRAVEL  : {}\n".format(str(self.feed_travel))

        gcode_feed_parameter = gcode_feed_print + gcode_feed_retract + gcode_feed_travel

        return gcode_feed_parameter


class ParametersTemperature():

    def __init__(self, temp_nozzle=None, temp_bed=None):
        
        self.temp_nozzle = temp_nozzle
        self.temp_bed = temp_bed

    def define_print_parameter(self):
            
        ### For Header
        gcode_temp_nozzle = "; TEMP_NOZZLE : {}\n".format(str(self.temp_nozzle))
        gcode_temp_bed =    "; TEMP_BED    : {}\n".format(str(self.temp_bed))

        gcode_temp_parameter = gcode_temp_nozzle + gcode_temp_bed

        return gcode_temp_parameter


################################################################


class MarlinGcodeHeader():
    
    def __init__(self, now, component_info, param_e, param_feed, param_temp, fan, z_buffer):
        
        self.now = now
        self.component_info = component_info
        self.param_e = param_e
        self.param_feed = param_feed
        self.param_temp = param_temp
        self.fan = fan
        self.z_buffer = z_buffer

    def define_header_top(self):

        t0 = "; GH_Gcode for HW\n"
        t1 = "; Polyline to Gcode by Grasshopper\n"
        t2 = "; For Mariln 3D Printer\n"

        return t0 + t1 + t2

    def define_print_parameter(self):

        prm_e = self.param_e
        prm_f = self.param_feed
        prm_t = self.param_temp

        ____line____ = "; ----- Print Parameter -----\n"

        ### Time Stamp
        time = "; Export Time : {}\n".format(self.now)
        
        ### Print Parameter
        print_comp = "; Component Info : {}\n".format(self.component_info)

        ### Extrude
        print_extrude = prm_e.define_print_parameter()

        ### Feed
        print_feed = prm_f.define_print_parameter()

        ### Temp
        print_temp = prm_t.define_print_parameter()

        ### Other
        print_fan = "; FAN : {}\n".format(str(self.fan))
        print_z_buffer = "; Z_BUFFER : {}\n".format(str(self.z_buffer))
        
        print_prm = [
            ____line____,
            time,
            print_comp,
            print_extrude,
            print_feed,
            print_temp,
            print_fan,
            print_z_buffer,
            ____line____]

        print_prm_join = "".join(print_prm)

        return print_prm_join

    def define_header(self):

        top = self.define_header_top()
        prms = self.define_print_parameter()

        return top + prms


################################################################


class MarlinGcodeMachineSetup():


    def __init__(self, param_temp, fan):

        self.param_temp = param_temp
        self.fan = fan


    def define_general_settings(self):

        ################################

        ### G90 - Absolute Positioning
        set_g90 = "G90 ; Absolute Positioning\n"

        ### M82 - E Absolute Mode
        set_m82 = "M82 ; E Absolute Mode\n"

        ### Set Tool
        set_t0 = "T0\n"

        ################################

        settings = set_g90 + set_m82 + set_t0

        return settings


    def start_fan(self):
        
        ### M106 - Set Fan Speed
        set_fan = "M106 S{} ; Set - Fan\n".format(str(self.fan))

        return set_fan


    def start_bed(self):
        
        prm_t = self.param_temp

        ### M140 - Set Bed Temperature
        ### M190 - Wait for Bed Temperature

        set_temp_bed = "M140 S{} ; Set - Temp Bed\n".format(str(prm_t.temp_bed))

        if float(prm_t.temp_bed) < 40:
            return set_temp_bed

        else:
            wait_temp_bed = "M190 S{} ; Wait - Temp Bed\n".format(str(prm_t.temp_bed))
            return set_temp_bed + wait_temp_bed


    def start_extruder(self):

        prm_t = self.param_temp

        ### M104 - Set Hotend Temperature
        ### M109 - Wait for Hotend Temperature
        
        set_temp_extruder = "M104 S{} T0 ; Set - Temp Extruder\n".format(str(prm_t.temp_nozzle))
        wait_temp_extruder = "M109 S{} T0 ; Wait - Temp Extruder\n".format(str(prm_t.temp_nozzle))

        return set_temp_extruder + wait_temp_extruder


    def homing_all_axes(self):
        
        ### G28 - Auto Home
        homing = "G28 ; Homing\n"

        return homing


    def homing_x(self):
        
        ### G28 - Auto Home
        homing = "G28 X0 ; Homing X\n"

        return homing

    
    def auto_leveling(self):

        ### G29 - Auto Leveling
        leveling_auto = "G29 ; Auto Leveling\n"

        return leveling_auto


    def reset_extrude_value(self):

        ### G92 - Set Position
        reset_e = "G92 E0 ; Reset Extruder Value, for Start Code\n"

        return reset_e


    def machine_start(self):

        start = []

        ################################

        start.append("; ----- Start Code -----\n")

        ### General Setting
        start.append(self.define_general_settings())
        
        ### Start Fan
        start.append(self.start_fan())

        ### Start Bed
        start.append(self.start_bed())

        ### Start Extruder
        start.append(self.start_extruder())

        ### Homing
        start.append(self.homing_all_axes())

        ### Leveling
            ### Ref
            ### hineri_kazamatsuri.gcode
        # start.append(self.auto_leveling())

        ### Reset Extruder Value
        start.append(self.reset_extrude_value())

        start.append("; ----- Start Code -----\n")

        ################################

        start_join = "".join(start)

        return start_join


    def machine_end(self):

        end = []

        ################################

        end.append("; ----- End Code -----\n")

        ### Homing X
        end.append(self.homing_x())

        ### End Part
        end.append("M106 S0 ; turn off cooling fan\n")
        end.append("M104 S0 ; turn off extruder\n")
        end.append("M140 S0 ; turn off bed\n")
        end.append("M84 ; disable motors\n")

        end.append("; ----- End Code -----\n")

        ################################

        end_join = "".join(end)

        return end_join


################################################################


class MarlinGcodePrinting():

    def __init__(self, point_lists, params_e, params_f, z_buffer):
        
        self.point_lists = point_lists
        self.params_e = params_e
        self.params_f = params_f
        self.z_buffer = z_buffer


    def reset_extrude_value(self):

        ### G92 - Set Position
        reset_e = "G92 E0 ; Reset Extruder Value\n"

        return reset_e


    def z_escape(self, z_current, z_zuffer):

        ### Z_Escape

        gcode = []

        comment = "; --- Z_Excape ---\n"

        gz = str("{:.4f}".format(z_current + float(z_zuffer)))
        code_z_escape = "G1 Z{}\n".format(gz)

        ################################

        gcode.append(comment)
        gcode.append(code_z_escape)
        gcode.append(comment)

        ################################

        gcode_join = "".join(gcode)

        return gcode_join


    def retract(self):

        ### E_Retract

        prm_e = self.params_e
        e_retract = prm_e.extrude_retract

        prm_f = self.params_f
        feed_retract = prm_f.feed_retract

        gcode = []

        comment = "; --- E_Retract ---\n"
        
        ### Reset Extruder Value
        code_reset = self.reset_extrude_value()
        
        v_e = str("{:.4f}".format(float(e_retract)))
        v_f = str(int(feed_retract))

        code_retract = "G0 E-{} F{}\n".format(v_e, v_f)
        
        ################################
        
        gcode.append(comment)
        gcode.append(code_reset)
        gcode.append(code_retract)
        gcode.append(code_reset)
        gcode.append(comment)

        ################################

        gcode_join = "".join(gcode)

        return gcode_join


    def retract_back(self):

        ### E_Retract_Back

        prm_e = self.params_e
        e_retract_back = prm_e.extrude_retract_back

        prm_f = self.params_f
        feed_retract = prm_f.feed_retract

        gcode = []

        comment = "; --- E_Retract_Back ---\n"

        ### Reset Extruder Value
        code_reset = self.reset_extrude_value()
        
        v_e = str("{:.4f}".format(float(e_retract_back)))
        v_f = str(int(feed_retract))

        code_retract_back = "G0 E{} F{}\n".format(v_e, v_f)
 
        ################################

        gcode.append(comment)
        gcode.append(code_reset)
        gcode.append(code_retract_back)
        gcode.append(code_reset)
        gcode.append(comment)

        ################################

        gcode_join = "".join(gcode)

        return gcode_join


    def points_to_gcode(self, count, pts):
        
        prm_e = self.params_e
        prm_f = self.params_f
        z_buffer = self.z_buffer

        e_amp = prm_e.extrude_amp

        f_print = prm_f.feed_print
        f_travel = prm_f.feed_travel

        ### CR-10 / TPU
        PRINTER_PARAMETER = 0.165


        layer = []

        travel_start_comment = "; -- Travel_Start --\n"
        travel_end_comment =   "; -- Travel_End --\n"

        print_start_comment = "; -- Print_Start --\n"
        print_end_comment =   "; -- Print_End --\n"


        for i in xrange(len(pts)):

            p = pts[i]
            xx, yy, zz = p

            ### Index[0]
            if i == 0:

                ### Initialize
                ee = 0

                ### Layer Info (Comment)
                start_comment = "; ----- Layer : {} / start -----\n".format(count)
                layer.append(start_comment)

                layer.append(travel_start_comment)

                ### Reset Extruder Value
                layer.append(self.reset_extrude_value())

                gx = str("{:.4f}".format(xx))
                gy = str("{:.4f}".format(yy))
                gz = str("{:.4f}".format(zz))
                gf = str("{}".format(f_travel))

                gcode = "G1 X{} Y{} Z{} E0 F{}\n".format(gx, gy, gz, gf)
                layer.append(gcode)

                if int(count) != 0:

                    ### E_Retract_Back
                    layer.append(self.retract_back())

                layer.append(travel_end_comment)



            ### Index[1] - Index[Last]
            else:
                x0, y0, z0 = pts[i - 1]
                x1, y1, z1 = pts[i]
                
                distance = CalcVector.calc_distance_2pt(x0, y0, z0, x1, y1, z1)

                ### PRINTER_PARAMETER // 1.85 to 0.4
                ### e_amp // override
                ee += (distance * float(PRINTER_PARAMETER) * float(e_amp))

                gx = str("{:.4f}".format(xx))
                gy = str("{:.4f}".format(yy))
                gz = str("{:.4f}".format(zz))
                ge = str("{:.4f}".format(ee))
                gf = str("{}".format(f_print))
                
                gcode = "G1 X{} Y{} Z{} E{} F{}\n".format(gx, gy, gz, ge, gf)
                layer.append(gcode)
            
                ### Index[Last]
                if i == (len(pts) - 1):

                    ### E_Retract
                    layer.append(self.retract())

                    ### Z_Escape
                    # z_escape = self.z_escape(zz, z_buffer)
                    # layer.append(z_escape)

                    ### Layer Info (Comment)
                    end_comment = "; ----- Layer : {} / end   -----\n".format(count)
                    layer.append(end_comment)

        ### Join
        layer_join = "".join(layer)

        return layer_join


    def point_lists_to_gcode(self):

        gcode = []

        point_lists = self.point_lists

        for i in xrange(len(point_lists)):

            pts = point_lists[i]
            layer_count = str(i)

            gcode.append(self.points_to_gcode(layer_count, pts))

        ### Join
        gcode_join = "".join(gcode)

        return gcode_join




class MarlinGcodeGenerate():


    def gcode_generate(self, point_lists, now, component_info, params_e, params_feed, params_temp, fan, z_buffer):

        """

        point_lists = 
            [layer1-point_list, layer2-point_list, layer3-point_list, ...]
        
        layer1-point_list = 
            [Rhino.Point3d(x00, y00, z00), Rhino.Point3d(x01, y01, z01), Rhino.Point3d(x02, y02, z02), ...]

        """

        gcode = []

        header = MarlinGcodeHeader(now, component_info, params_e, params_feed, params_temp, fan, z_buffer)
        machine_setup = MarlinGcodeMachineSetup(params_temp, fan)
        printing = MarlinGcodePrinting(point_lists, params_e, params_feed, z_buffer)


        ################################

        ### (1) Print Header, Parameters
        gcode.append(header.define_header())


        ### (2) Machine Start
        gcode.append(machine_setup.machine_start())


        ### (3) Printing
        gcode.append(printing.point_lists_to_gcode())


        ### (4) Machine End
        gcode.append(machine_setup.machine_end())

        ################################


        ### Join
        gcode_join = "".join(gcode)

        return gcode_join


gcode_generator = MarlinGcodeGenerate()



##########

##########


BUILD_DAY = "221231"


ghenv.Component.Message = "2) Points to gcode / {}".format(BUILD_DAY)
COMPONENT_INFO = "ver_{}".format(BUILD_DAY)


NOW = Util.get_current_time()

Z_OFFSET_VALUE = INFO
FAN = 0

PARAMS_EXTRUDE = ParametersExtrude(E_AMP, E_RETRACT, E_RETRACT_BACK)
PARAMS_FEED = ParametersFeed(FEED_PRINT, FEED_RETRACT, FEED_TRAVEL)
PARAMS_TEMP = ParametersTemperature(TEMP_NOZZLE, TEMP_BED)


### Points to Gcode (Not Go Through Machine Origin)
if RUN_AND_EXPORT:
    gcode = gcode_generator.gcode_generate(POINTS, NOW, COMPONENT_INFO, PARAMS_EXTRUDE, PARAMS_FEED, PARAMS_TEMP, FAN, Z_BUFFER)
    Util.export_gcode(EXPORT_DIR, NOW, gcode)

    ### For DEBUG
    # print(NOW)
# ---------- end python_3 ----------

# ---- group: for DEV
# Develop Ver
# ---
# In DevelopEnv, Run *.py Directly
# 
# Show "code" input and  Set "Input is Path"
# Windows Only??
python_4 = GhPythonScript(
    Code=txt_3,
    POINTS=polyline_to_points.POINTS,
    INFO=polyline_to_points.INFO,
    E_AMP=panel_11,
    E_RETRACT=panel_10,
    E_RETRACT_BACK=panel_12,
    FEED_PRINT=panel_14,
    FEED_RETRACT=panel_15,
    FEED_TRAVEL=panel_16,
    TEMP_NOZZLE=panel_5,
    TEMP_BED=panel_6,
    Z_BUFFER=panel_13,
    EXPORT_DIR=txt_2,
    RUN_AND_EXPORT=toggle)  # -> Out, DEV; disabled

# ----
panel_21 = Panel(python_3.out)
panel_22 = Panel(python_4.Out)

# ---- group: (0) Breps to Polyline
contour = Contour(Shape=brep_3, Point=Point(0, 0, 0), Direction=Vector(0, 0, 1), Distance=number_slider)
trim = TrimTree(Tree=contour, Depth=1)

# ---- group: (0) Breps to Polyline / Remove Z=0 Curve
midpt = CurveMiddle(Curve=trim)
pdecon = Deconstruct(Point=midpt)  # -> XComponent, YComponent, ZComponent
smaller = SmallerThan(FirstNumber="0.01", SecondNumber=pdecon.ZComponent)  # -> SmallerThan, OrEqualTo
dispatch = Dispatch(List=trim, DispatchPattern=smaller.SmallerThan)  # -> ListA, ListB

# ---- group: (0) Breps to Polyline / Remove Z=0 Curve / Printable
# Base Script >>> GH_Gcode
#     - Repository : https://github.com/naysok/GH_Gcode
#     - Coding : naoki yoshioka (naysok)
#     - License : MIT License
crv_5 = Curve(dispatch.ListA)

# ---- group: (0) Breps to Polyline / Remove Z=0 Curve / Remove : Z = 0
crv_6 = Curve(dispatch.ListB)

# ---- group: (0) Breps to Polyline / Sort Curve
flatten_2 = FlattenTree(Tree=crv_5, Path="{0}")
midpt_2 = CurveMiddle(Curve=flatten_2)
pdecon_2 = Deconstruct(Point=midpt_2)  # -> XComponent, YComponent, ZComponent
sort = SortList(Keys=pdecon_2.ZComponent, ValuesA=flatten_2)  # -> Keys, ValuesA

# ---- group: (0) Breps to Polyline (continued)
topoly = CurveToPolyline(Curve=sort.ValuesA, ToleranceDistance=0, ToleranceAngle=0)  # -> Polyline, Segments

# ---- group: (0) Breps to Polyline / OUTPUT : Polylines
crv_7 = Curve(topoly.Polyline)
